# Grasshopper definition 00-DSVI_Site_analysis_00.gh (Grasshopper 1.0.7)
# plug-ins: Weaverbird, Docofossor, Groundhog, Human

points_cloud_vegetation = Point([Point(816.399997, 870.63, 41.94), Point(822.389997, 873.5, 43.96), Point(823.329997, 876.27, 42.41), Point(838.579997, 862.99, 43.22), Point(835.999997, 880.98, 42.17), Point(899.059997, 874.53, 50.93)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])
lng = ListLength(List=points_cloud_vegetation)
random = Random(Range="6 to 12", Number=lng, Seed=Slider(37, range=0..100))
wbicosahedron = WeaverbirdsMeshMeshIcosahedron(Plane=points_cloud_vegetation, Radius=random)
wbcatmullclark = WeaverbirdsCatmullClarkSubdivision(MeshCurves=wbicosahedron, Level=1, SmoothNakedEdges=1)

docofossor_site_data_df = Data([295, 342, 816, 857, 2.5, 2.5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])

# ----
# SURROUNDING SITES
surroundings_projected_on_mesh = Curve([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])
surroundings_2d = Curve([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])
previewlw = CustomPreviewLineweights(
    Geometry=surroundings_projected_on_mesh,
    Shader=ColourSwatch(SwatchColor=RGB(29, 23, 153)),
    Thickness=Slider(0.3, range=0..3),
    Absolute=Toggle(True))

# ----
# SITE BOUNDARY
site_boundary_projected = Curve(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)
site_boundary_2d = Curve(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)
previewlw_2 = CustomPreviewLineweights(
    Geometry=site_boundary_projected,
    Shader=ColourSwatch(SwatchColor=RGB(191, 29, 29)),
    Thickness=Slider(3, range=0..3),
    Absolute=Toggle(True))

# ----
# WATER
creek_bed_projected = Curve(Tree({0;0;0;0;0}: [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], {0;0;0;0;1}: [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]))
creek_bed_2d = Curve([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])
water_table_projected = Curve(Tree({0;0;0;0;0}: [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], {0;0;0;0;1}: [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]))
water_table_2d = Curve([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])
previewlw_3 = CustomPreviewLineweights(
    Geometry=creek_bed_projected,
    Shader=ColourSwatch(SwatchColor=RGB(31, 156, 209)),
    Thickness=Slider(3, range=0..3),
    Absolute=Toggle(True))
previewlw_4 = CustomPreviewLineweights(
    Geometry=water_table_projected,
    Shader=ColourSwatch(SwatchColor=RGB(150, 218, 242)),
    Thickness=Slider(3, range=0..3),
    Absolute=Toggle(True))

Z = UnitZ(Factor=Slider(30, range=0..100))

# ----
# TERRAIN MESH VISUALISER
grid_mesh = GridMesh(Df=docofossor_site_data_df)
preview = CustomPreview(Geometry=grid_mesh, Material=ColourSwatch(SwatchColor=RGBA(128, 128, 128, 211)))

medges = MeshEdges(Mesh=grid_mesh)  # -> NakedEdges, InteriorEdges, NonManifoldEdges
join = JoinCurves(Curves=medges.NakedEdges, Preserve=False)
contour = Contour(Shape=grid_mesh, Point=Point(0, 0, 0), Direction=Vector(0, 0, 1), Distance=Slider(1, range=0..10))
project = Project(Geometry=join, Plane=PlaneXY(0, 0, 0))  # -> Geometry, Transform
move = Move(Geometry=project.Geometry, Motion=Z)  # -> Geometry, Transform
loft = Loft(
    Curves=[join, move.Geometry],
    Options={Adjust=False, Closed=False, LoftEnds=0, LoftSimp=0, LoftType=3, Rebuild=10, Refit=0.01})
qrmesh = QuadRemesh(Mesh=loft, Settings={aqc=True, as=50, dhe=True, gci=0, null=False, pme=0, sa=0, tqc=2000})
number_slider = Slider(15, range=0..100)  # disabled
number_slider_2 = Slider(30, range=0..100)  # disabled
srf = Surface(<surface referenced from the Rhino model>)  # disabled

# ----
# TREES VISUALISER
swatch = ColourSwatch(SwatchColor=RGBA(38, 69, 24, 123))
preview_2 = CustomPreview(Geometry=wbcatmullclark, Material=swatch)

preview_3 = CustomPreview(Geometry=qrmesh, Material=ColourSwatch(SwatchColor=RGB(46, 46, 46)))

# ----
# CONTOURS VISUALISER
swatch_2 = ColourSwatch(SwatchColor=RGB(71, 71, 71))
previewlw_5 = CustomPreviewLineweights(Geometry=contour, Shader=swatch_2, Thickness=Slider(0.08, range=0..3), Absolute=Toggle(True))

dfcutfillinsurface = CutFillInSurface(Df=docofossor_site_data_df, Srf=srf, Sa=number_slider, D=number_slider_2)  # -> Df, Vol; disabled
panel = Panel("http://climate.onebuilding.org/WMO_Region_5_Southwest_Pacific/AUS_Australia/SA_South_Australia/AUS_SA_Kuitpo.Forest.Reserve.946830_TMYx.zip")
downloadepw = LBDownloadWeather(weather_URL=panel)  # -> epw_file, stat_file, ddy_file; plug-in component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
importepw = LBImportEPW(epw_file=downloadepw.epw_file)  # -> location, dry_bulb_temperature, dew_point_temperature, relative_humidity, wind_speed, wind_direction, direct_normal_rad, diffuse_horizontal_rad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; plug-in component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

# ----
# SATURATION AND FLOOD
number_slider_3 = Slider(3000, range=0..10000)  # disabled
popgeo = PopulateGeometry(Geometry=grid_mesh, Count=number_slider_3, Seed=1)  # disabled
toggle = BooleanToggle(True)  # disabled
mesh_flows = FlowProjectionMesh(Mesh=grid_mesh, Points=popgeo, Jump=0, Steps=0, Thread=toggle)  # -> FlowPoints, FlowPaths; disabled
crv = Curve(mesh_flows.FlowPaths)  # disabled
saturation = FlowSaturation(Mesh=grid_mesh, FlowPaths=crv)  # -> FlowOverlaps, FlowVolumes, MeshFaces, FaceCenters, PathVolumes; disabled
number_slider_4 = Slider(295, range=0..1000)  # disabled
gradient = Gradient(
    LowerLimit=0,
    UpperLimit=number_slider_4,
    Parameter=saturation.FlowVolumes,
    stops=[0: RGB(255, 255, 255), 0.547: RGB(173, 216, 230), 1: RGB(70, 130, 180)])  # disabled
mesh = Mesh(saturation.MeshFaces)  # disabled
mcol = MeshColours(Mesh=simplify(graft(mesh)), Colours=simplify(graft(gradient)))  # disabled

# ----
# SLOPE ANALYSIS
slope = MeshSlope(Mesh=grid_mesh)  # -> MeshFaces, FaceCenters, FaceVectors, FaceSlopes, FaceSlopes_2, FaceSlopes_3; disabled
number_slider_5 = Slider(15, range=0..100)  # disabled
number_slider_6 = Slider(10, range=0..100)  # disabled
number_slider_7 = Slider(5, range=0..100)  # disabled
expression = Expression(x=slope.FaceSlopes_2, y=number_slider_7, z=number_slider_6, Expression="if( x>y,if(x<z, True, False), False)")  # disabled
expression_2 = Expression(x=slope.FaceSlopes_2, y=number_slider_6, z=number_slider_5, Expression="if( x>y,if(x<z, True, False), False)")  # disabled
smaller = SmallerThan(FirstNumber=slope.FaceSlopes_2, SecondNumber=number_slider_7)  # -> SmallerThan, OrEqualTo; disabled
larger = LargerThan(FirstNumber=slope.FaceSlopes_2, SecondNumber=number_slider_5)  # -> LargerThan, OrEqualTo; disabled
cull = CullPattern(List=slope.MeshFaces, CullPattern=smaller.SmallerThan)  # disabled
cull_2 = CullPattern(List=slope.MeshFaces, CullPattern=expression)  # disabled
cull_3 = CullPattern(List=slope.MeshFaces, CullPattern=expression_2)  # disabled
cull_4 = CullPattern(List=slope.MeshFaces, CullPattern=larger.LargerThan)  # disabled
swatch_3 = ColourSwatch(SwatchColor=RGB(38, 49, 255))  # disabled
swatch_4 = ColourSwatch(SwatchColor=RGB(212, 212, 212))  # disabled
swatch_5 = ColourSwatch(SwatchColor=RGB(134, 54, 255))  # disabled
swatch_6 = ColourSwatch(SwatchColor=RGB(0, 0, 0))  # disabled
mcol_2 = MeshColours(Mesh=cull_4, Colours=swatch_6)  # disabled
mcol_3 = MeshColours(Mesh=cull_3, Colours=swatch_3)  # disabled
mcol_4 = MeshColours(Mesh=cull_2, Colours=swatch_5)  # disabled
mcol_5 = MeshColours(Mesh=cull, Colours=swatch_4)  # disabled
visualiser = Data([mcol_5, mcol_4, mcol_3, mcol_2])  # disabled

series = Series(Start="5", Step=1, Count="15")
hoy = LBCalculateHOY(month=Slider(6, range=1..12), day="21", hour=series)  # -> flatten(hoy), flatten(doy), flatten(date); plug-in component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

# ----
# RAIN FLOW
number_slider_8 = Slider(1000, range=0..1000)  # disabled
popgeo_2 = PopulateGeometry(Geometry=grid_mesh, Count=number_slider_8, Seed=1)  # disabled
toggle_2 = BooleanToggle(True)  # disabled
mesh_flows_2 = FlowProjectionMesh(Mesh=grid_mesh, Points=popgeo_2, Jump=0, Steps=0, Thread=toggle_2)  # -> FlowPoints, FlowPaths; disabled
crv_2 = Curve(mesh_flows_2.FlowPaths)  # disabled
number_slider_9 = Slider(0.15, range=0..1)  # disabled
swatch_7 = ColourSwatch(SwatchColor=RGB(90, 95, 107))  # disabled
toggle_3 = BooleanToggle(True)  # disabled
previewlw_6 = CustomPreviewLineweights(Geometry=crv_2, Shader=swatch_7, Thickness=number_slider_9, Absolute=toggle_3)  # disabled

# ---- group: CONTROLS THE SCALE
number_slider_10 = Slider(18, range=0..50)

# ----
# WIND ROSE
number_slider_11 = Slider(1, range=1..12)
analysisperiod = LBAnalysisPeriod(start_month=number_slider_11, start_day=1, start_hour=0, end_month=Slider(12, range=1..12))  # -> period, hoys, dates; plug-in component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
pt = Point(Point(1026.473675, 1231.809167, 80.7846375))
windrose = LBWindRose(
    data=importepw.wind_speed,
    wind_direction=importepw.wind_direction,
    center_pt=pt,
    freq_dist=number_slider_10,
    period=analysisperiod.period)  # -> report, mesh, compass, orient_line, freq_line, windrose_line, legend, title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; plug-in component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
data = Data(windrose.legend)
data_2 = Data([windrose.compass, windrose.windrose_line, windrose.orient_line])
mesh_2 = Mesh(windrose.mesh)
previewlw_7 = CustomPreviewLineweights(
    Geometry=data_2,
    Shader=ColourSwatch(SwatchColor=RGB(0, 0, 0)),
    Thickness=Slider(0.08, range=0..3),
    Absolute=Toggle(True))
previewlw_8 = CustomPreviewLineweights(Geometry=data, Shader=ColourSwatch(SwatchColor=RGB(0, 0, 0)), Thickness=Slider(0.08, range=0..3), Absolute=Toggle(True))

# ----
# SUNPATH
pcen = PolygonCenter(Polyline=site_boundary_projected)  # -> CenterV, CenterE, CenterA
sunpath = LBSunPath(location=importepw.location, hoys=hoy.hoy, center_pt=pcen.CenterV, scale=Slider(5, range=0..10))  # -> report, vectors, altitudes, azimuths, hoys, sun_pts, analemma, daily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; plug-in component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
data_3 = Data([sunpath.analemma, sunpath.compass, sunpath.daily])
previewlw_9 = CustomPreviewLineweights(
    Geometry=data_3,
    Shader=ColourSwatch(SwatchColor=RGB(0, 0, 0)),
    Thickness=Slider(0.08, range=0..3),
    Absolute=Toggle(True))

# ---- group: Set to True to run the analysis
toggle_4 = BooleanToggle(False)

# ----
# SUNLIGHT HOURS ANALYSIS
number_slider_12 = Slider(0.25, range=0..1)
directsunhours = LBDirectSunHours(
    vectors=flatten(sunpath.vectors),
    geometry=flatten(grid_mesh),
    context=flatten(wbicosahedron),
    grid_size=Slider(1, range=0..10),
    offset_dist=number_slider_12,
    cpu_count="8",
    run=toggle_4)  # -> report, points, results, mesh, legend, title, int_mtx; plug-in component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
